# Grasshopper definition messy_input.gh (Grasshopper 1.0.8)

amp = Slider(0.6, range=0..2)
V = Slider(6, range=2..20)
freq = Slider(2, range=0.5..6)
pt = Point(Point(0, 0, 0))
W = Slider(30, range=5..60)
depth = Slider(0.8, range=0.1..2)
Y = UnitY(Factor=depth)
U = Slider(12, range=2..40)
xz = XZPlane(Origin=pt)
H = Slider(12, range=3..40)
rectangle = Rectangle(Plane=xz, XSize=W, YSize=H, Radius=0)  # -> Rectangle, Length
boundary = BoundarySurfaces(Edges=rectangle.Rectangle)
divide = DivideDomain²(Domain=boundary, UCount=U, VCount=V)
subsrf = Isotrim(Surface=boundary, Domain=divide)
lng = ListLength(List=subsrf)
area = Area(Geometry=subsrf)  # -> Area, Centroid
pdecon = Deconstruct(Point=area.Centroid)  # -> XComponent, YComponent, ZComponent
multiplication = Multiplication(A=pdecon.XComponent, B=freq)
sin = Sine(Value=multiplication)
multiplication_2 = Multiplication(A=sin, B=amp)
abs = Absolute(Value=multiplication_2)
addition = Addition(A=abs, B=0.2)
scale = Scale(Geometry=subsrf, Center=area.Centroid, Factor=addition)  # -> Geometry, Transform
panel = Panel(lng)
edges = BrepEdges(Brep=scale.Geometry)  # -> Naked, Interior, NonManifold
join = JoinCurves(Curves=edges.Naked, Preserve=False)
extr = Extrude(Base=join, Direction=Y)
cap = CapHoles(Brep=extr)
preview = CustomPreview(Geometry=cap, Material=ColourSwatch(SwatchColor=RGB(90, 140, 180)))
