# Grasshopper definition house_karamba.gh (Grasshopper 1.0.8)
# plug-ins: Karamba3D

# ---- group: Sections
matselect = MaterialSelectionKaramba3D(NameOrListIndexOfMaterial="C30/37", menu=[dropdown(0), dropdown(0), dropdown(0)])
crosec = CrossSectionKaramba3D(
    FamilyNameOfCrossSection="DefaultCroSec",
    Material=matselect,
    Height_cm=30,
    UpperFlangeWidth_cm=30,
    LowerFlangeWidth_cm=30,
    mode="Trapezoid")
crosec_2 = CrossSectionKaramba3D(FamilyNameOfCrossSection="DefaultCroSec", Material=matselect, Height_cm=20, mode="Shell - Const")

# ---- group: FE geometry from Rhino
fe_lines = Curve([<curve referenced from the Rhino model> x14])
fe_shells = Brep([<brep referenced from the Rhino model> x6])
mesh_size_m = Slider(3.5, range=0.2..6)

# ---- group: Elements
lineelem = CreateLinearElementKaramba3D(
    Line=fe_lines,
    CrossSection=crosec,
    LimitDistance_m=0.005,
    BucklingLengthY_m=-1,
    BucklingLengthZ_m=-1,
    BucklingLengthLT_m=-1,
    Bending=True,
    ToPolylineMaxAngle=0.25,
    ToPolylineTolerance=0.1,
    ToPolylineMaxEdgeLength=0.25,
    New=True,
    Remove=True,
    mode="LineToBeam",
    GuidGeneratorSeed=-701148635)  # -> Element, Points, Info
mesh_breps = MeshBrepsKaramba3D(
    Brep=fe_shells,
    InclusionPoints=flatten(lineelem.Points),
    MeshResolution=mesh_size_m,
    EdgeRefinementFactor=0.67,
    PointReduction=False,
    SmoothingStepSize=0,
    SmoothingIterations=5)  # -> Mesh, Info
surfelem = CreateSurfaceElementKaramba3D(
    Mesh=mesh_breps.Mesh,
    CrossSection=crosec_2,
    LimitDistance_m=0.005,
    Bending=True,
    mode="MeshToShell",
    GuidGeneratorSeed=-1182311555)  # -> Element, Points, Info

# ---- group: Supports at z=0
demesh = DeconstructMesh(Mesh=mesh_breps.Mesh)  # -> Vertices, Faces, Colours, Normals
merge = Merge(Data1=flatten(lineelem.Points), Data2=flatten(demesh.Vertices))
pdecon = Deconstruct(Point=merge)  # -> XComponent, YComponent, ZComponent
smaller = SmallerThan(FirstNumber=pdecon.ZComponent, SecondNumber=0.01)  # -> SmallerThan, OrEqualTo
cull = CullPattern(List=merge, CullPattern=smaller.SmallerThan)
supp = SupportKaramba3D(PosInd=cull, Ct_kN_m=Vector(0, 0, 0), Cr_kNm_rad=Vector(0, 0, 0), menu=[buttons(on, on, on, on, on, on)])

# ---- group: Model + analysis
loads = LoadsKaramba3D(Vector=Vector(0, 0, -1), LCase="LC0", mode="Gravity")
assemble = AssembleModelKaramba3D(Elem=flatten([lineelem.Element, surfelem.Element]), Support=flatten(supp), Load=flatten(loads), LimitDistance_m=0.005)  # -> Model, Info, Mass_kg, CentreOfGravity, LoadCaseNames
analyse = AnalyseKaramba3D(Model=assemble.Model)  # -> AnalysedModel, MaximumDisplacement_cm, ResultingForce_kN, ChangeOfElasticEnergy_kNm
modelview = ModelViewKaramba3D(Model=analyse.AnalysedModel)  # -> Model, DeformedMesh, DeformedAxes, DeformedModel, MaximumDeformation

# ---- group: Results
mass_kg = Panel(assemble.Mass_kg)
max_disp_cm = Panel(analyse.MaximumDisplacement_cm)
assemble_info = Panel(assemble.Info)
