# Grasshopper definition tidy_output.gh (Grasshopper 1.0.8)

# ---- group: Inputs
pt = Point(Point(0, 0, 0))
W = Slider(30, range=5..60)
H = Slider(12, range=3..40)
U = Slider(12, range=2..40)
V = Slider(6, range=2..20)
freq = Slider(2, range=0.5..6)
amp = Slider(0.6, range=0..2)
depth = Slider(0.8, range=0.1..2)

# ---- group: Base surface
xz = XZPlane(Origin=pt)
rectangle = Rectangle(Plane=xz, XSize=W, YSize=H, Radius=0)  # -> Rectangle, Length
boundary = BoundarySurfaces(Edges=rectangle.Rectangle)

# ---- group: Panel grid
divide = DivideDomain²(Domain=boundary, UCount=U, VCount=V)
subsrf = Isotrim(Surface=boundary, Domain=divide)
lng = ListLength(List=subsrf)
panel = Panel(lng)
area = Area(Geometry=subsrf)  # -> Area, Centroid

# ---- group: Wave scaling
pdecon = Deconstruct(Point=area.Centroid)  # -> XComponent, YComponent, ZComponent
multiplication = Multiplication(A=pdecon.XComponent, B=freq)
sin = Sine(Value=multiplication)
multiplication_2 = Multiplication(A=sin, B=amp)
abs = Absolute(Value=multiplication_2)
addition = Addition(A=abs, B=0.2)
scale = Scale(Geometry=subsrf, Center=area.Centroid, Factor=addition)  # -> Geometry, Transform

# ---- group: Fins
edges = BrepEdges(Brep=scale.Geometry)  # -> Naked, Interior, NonManifold
join = JoinCurves(Curves=edges.Naked, Preserve=False)
Y = UnitY(Factor=depth)
extr = Extrude(Base=join, Direction=Y)
cap = CapHoles(Brep=extr)

# ---- group: Display
preview = CustomPreview(Geometry=cap, Material=ColourSwatch(SwatchColor=RGB(90, 140, 180)))
