# Grasshopper definition tidy_relays.gh (Grasshopper 1.0.8)
# plug-ins: jSwan, ggRhinoIFC

# ---- group: Inputs
pt = Point(Point(0, 0, 0))
W = Slider(30, range=5..60)
H = Slider(12, range=3..40)
U = Slider(12, range=2..40)
V = Slider(6, range=2..20)
freq = Slider(2, range=0.5..6)
amp = Slider(0.6, range=0..2)
depth = Slider(0.8, range=0.1..2)
pt_out = Pt_Out(pt)
w_out = W_Out(W)
h_out = H_Out(H)
u_out = U_Out(U)
v_out = V_Out(V)
freq_out = Freq_Out(freq)
amp_out = Amp_Out(amp)
depth_out = Depth_Out(depth)

# ---- group: Base surface
o_in = O_In(pt_out)
x_in = X_In(w_out)
y_in = Y_In(h_out)
xz = XZPlane(Origin=o_in)
rectangle = Rectangle(Plane=xz, XSize=x_in, YSize=y_in, Radius=0)  # -> Rectangle, Length
boundary = BoundarySurfaces(Edges=rectangle.Rectangle)
s_out = S_Out(boundary)

# ---- group: Panel grid
i_in = I_In(s_out)
u_in = U_In(u_out)
v_in = V_In(v_out)
divide = DivideDomain²(Domain=i_in, UCount=u_in, VCount=v_in)
subsrf = Isotrim(Surface=i_in, Domain=divide)
lng = ListLength(List=subsrf)
area = Area(Geometry=subsrf)  # -> Area, Centroid
panel = Panel(lng)
s_out_2 = S_Out(subsrf)
c_out = C_Out(area.Centroid)

# ---- group: Wave scaling
g_in = G_In(s_out_2)
p_in = P_In(c_out)
b_in = B_In(freq_out)
b_in_2 = B_In(amp_out)
pdecon = Deconstruct(Point=p_in)  # -> XComponent, YComponent, ZComponent
multiplication = Multiplication(A=pdecon.XComponent, B=b_in)
sin = Sine(Value=multiplication)
multiplication_2 = Multiplication(A=sin, B=b_in_2)
abs = Absolute(Value=multiplication_2)
addition = Addition(A=abs, B=0.2)
scale = Scale(Geometry=g_in, Center=p_in, Factor=addition)  # -> Geometry, Transform
g_out = G_Out(scale.Geometry)

# ---- group: Fins
b_in_3 = B_In(g_out)
f_in = F_In(depth_out)
edges = BrepEdges(Brep=b_in_3)  # -> Naked, Interior, NonManifold
join = JoinCurves(Curves=edges.Naked, Preserve=False)
Y = UnitY(Factor=f_in)
extr = Extrude(Base=join, Direction=Y)
cap = CapHoles(Brep=extr)
b_out = B_Out(cap)

# ---- group: Display
g_in_2 = G_In(b_out)
preview = CustomPreview(Geometry=g_in_2, Material=ColourSwatch(SwatchColor=RGB(90, 140, 180)))
